# Grasshopper definition 01_MultiFloor_SubWay_.gh (Grasshopper 1.0.8)
# plug-ins: BSim_001a

id = Guid([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])
geo = Geometry([<point referenced from the Rhino model> x822])
pt = Point([<point referenced from the Rhino model> x3684])
pt_2 = Point(geo)
merge = Merge(Data1=pt_2, Data2=pt)
c_script = CSharpScript(Expel=pt_2, Tol=Slider(0.01, range=0..1))  # -> out, A, B; inputs PtCloud: list of Point3d, Expel: list of Point3d, Tol: Double
# ---------- c_script: C# usings ----------
using System.Linq;
# ---------- c_script: C# ----------
    double tol = Tol;
    List<int> index = new List<int>();
    List<Point3d> exp = new List<Point3d>();
    for(int i = 0;i < PtCloud.Count;i++)
    {
      foreach(Point3d pt in Expel)
      {
        if(pt.DistanceTo(PtCloud[i]) < tol)
        {
          index.Add(i);
          exp.Add(pt);
        }
      }
    }

    A = PtCloud.Where((p,i) => !index.Contains(i));
    B = exp;
# ---------- end c_script ----------
pt_3 = Point(merge)
check_tooclosenodes = CSharpScript(NodeCloud=pt_3, Check_Tol=Slider(0.5, range=0..1))  # -> out, Ns, NsId, ErrorPts, Cycles; inputs NodeCloud: list of Point3d, Check_Tol: Double
# ---------- check_tooclosenodes: C# ----------
    double ToClosePts_Tol = Check_Tol > 0.0 ? Check_Tol : 1;

    //00 cleanup the duplicate nodes;
    RTree rtree = new RTree();
    for(int i = 0;i < NodeCloud.Count;i++){rtree.Insert(NodeCloud[i], i);}

    List<Point3d> nodes = new List<Point3d>();
    List<int> nodes_ori_ids = new List<int>();

    List<int> DupliIndex = new List<int>();

    for(int i = 0;i < NodeCloud.Count;i++)
    {
      if(DupliIndex.Contains(i)){continue;}

      Sphere SearchSp = new Sphere(NodeCloud[i], Check_Tol);
      List<int> match = new List<int>();
      rtree.Search(SearchSp, (sender, args) => {match.Add(args.Id);});

      if(match.Count > 1){DupliIndex.AddRange(match);}

      nodes.Add(NodeCloud[i]);
      nodes_ori_ids.Add(i);
    }



    Ns = nodes;
    NsId = nodes_ori_ids;

    ErrorPts = DupliIndex.Select(i => NodeCloud[i]);
    Cycles = DupliIndex.Select(i => NodeCloud[i]).Select(p => new Circle(p, Check_Tol));
# ---------- check_tooclosenodes: C# additional code ----------
  public static int? RT_ClosetPt(List<Point3d> ptCloud, RTree T, Point3d pt, double R)
  {
    Sphere SearchSp = new Sphere(pt, R);
    if (T != null)
    {
      List<int> candidates = new List<int>();
      T.Search(SearchSp, (sender, args) => { candidates.Add(args.Id); });
      if (candidates.Count > 0)
      {
        candidates.Sort((a, b) => ptCloud[a].DistanceTo(pt).CompareTo(ptCloud[b].DistanceTo(pt)));
        return candidates[0];
      }
      else { return null; }
    }
    else { return null; }
  }
# ---------- end check_tooclosenodes ----------
crv = Curve([<curve referenced from the Rhino model> x4604])
check_nodeedge_clouds = CSharpScript(NodeCloud=check_tooclosenodes.Ns, EdgeCloud=crv, tol=Slider(0.0001, range=0..1))  # -> out, Matched_Es, Matched_Ns, Error_E, Error_N; inputs NodeCloud: list of Point3d, EdgeCloud: list of Line, tol: Double
# ---------- check_nodeedge_clouds: C# ----------
    List<Point3d> nodes = NodeCloud;

    //01 match edge;
    double fixtol = tol;
    RTree rtree = new RTree();
    for(int i = 0;i < nodes.Count;i++){rtree.Insert(nodes[i], i);}
    List<List<int>> nodenodeAdj = nodes.Select(p => new List<int>()).ToList();
    List<Line> edges = new List<Line>();
    List<Line> edge_error = new List<Line>();

    for(int i = 0;i < EdgeCloud.Count;i++)
    {
      Point3d P0 = EdgeCloud[i].From;
      Point3d P1 = EdgeCloud[i].To;

      Sphere SearchSp0 = new Sphere(P0, fixtol);
      Sphere SearchSp1 = new Sphere(P1, fixtol);

      List<int> match0 = new List<int>();
      List<int> match1 = new List<int>();

      rtree.Search(SearchSp0, (sender, args) => { match0.Add(args.Id); });
      rtree.Search(SearchSp1, (sender, args) => { match1.Add(args.Id); });

      if(match0.Count > 0 && match1.Count > 0 && match0.Count == 1 && match1.Count == 1)
      {
        int ind0 = match0[0];
        int ind1 = match1[0];

        if(ind0 > ind1)
        {
          if(!nodenodeAdj[ind1].Contains(ind0))
          {nodenodeAdj[ind1].Add(ind0);}
        }
        else
        {
          if(!nodenodeAdj[ind0].Contains(ind1))
          {nodenodeAdj[ind0].Add(ind1);}
        }
      }
      else
      {
        edge_error.Add(EdgeCloud[i]);
      }

    }

    List<int> collection = new List<int>();

    for(int i = 0;i < nodenodeAdj.Count;i++)
    {
      if(nodenodeAdj[i].Count > 0 && !collection.Contains(i)){collection.Add(i);}
      foreach(int j in nodenodeAdj[i])
      {
        edges.Add(new Line(nodes[i], nodes[j]));
        if(!collection.Contains(j)){collection.Add(j);}
      }
    }

    //Detect Split
    double checkTol = 0.5;

    List<Point3d> errorNodes = new List<Point3d>();
    foreach(Point3d pt in nodes)
    {
      foreach(Line edge in edges)
      {
        if(edge.MinimumDistanceTo(pt) < checkTol)
        {
          if(pt.DistanceTo(edge.From) < checkTol || pt.DistanceTo(edge.To) < checkTol)
          {continue;}

          errorNodes.Add(pt);
        }
      }

    }

    Matched_Es = edges;
    Matched_Ns = collection.Select(p => nodes[p]);
    Error_E = edge_error;
    Error_N = errorNodes;
# ---------- check_nodeedge_clouds: C# additional code ----------
  public static int? RT_ClosetPt(List<Point3d> ptCloud, RTree T, Point3d pt, double R)
  {
    Sphere SearchSp = new Sphere(pt, R);
    if (T != null)
    {
      List<int> candidates = new List<int>();
      T.Search(SearchSp, (sender, args) => { candidates.Add(args.Id); });
      if (candidates.Count > 0)
      {
        candidates.Sort((a, b) => ptCloud[a].DistanceTo(pt).CompareTo(ptCloud[b].DistanceTo(pt)));
        return candidates[0];
      }
      else { return null; }
    }
    else { return null; }
  }
# ---------- end check_nodeedge_clouds ----------

# ----
# BSim
# If you use the BSim library, please reference the official GitHub repository:
# 
# @Misc{BSim2024,
# author = {Shen, Yuchi; Zhang, Mengting},
# title = {{BSim: Behaviour Simulator}},
# year = {2024},
# note = {Release 1.00 Beta},
# url = { https://github.com/YuchiSHEN/BSim.git },
# }
nickname = BSim()

enter_exits = Point([Point(230.6141239, 22.6585807, 0), Point(230.6141239, 21.66270059, 0), Point(230.6141239, 20.70915599, 0), Point(230.6141239, 19.78604505, 0)])
number_slider = Slider(1000, range=0..1000)
train_stations = Point([Point(311.8123852, 35.80344772, -10), Point(311.8124157, 17.10513879, -10), Point(304.3716744, 35.80344772, -10), Point(304.3717049, 17.10513879, -10), Point(296.9309395, 35.80344772, -10), Point(296.93097, 17.10513879, -10), Point(289.4902046, 35.80344772, -10), Point(289.4902351, 17.10513879, -10), Point(282.0494938, 35.80344772, -10), Point(282.0495243, 17.10513879, -10), Point(274.6087349, 35.80344772, -10), Point(274.6087654, 17.10513879, -10), Point(267.168, 35.80344771, -10), Point(267.1680306, 17.10513878, -10)])
agent_count = Slider(500, range=0..500)

subwaycase = Curve([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])
# ISpace
swatch = ColourSwatch(SwatchColor=RGB(128, 128, 128))
displaycurves = DisPlayCurves(cvs=flatten(subwaycase), cols=flatten(swatch), thick=flatten(Slider(1, range=0..10)))

# ----
# Agents
crv_2 = Curve([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])

# ----
# BuyTicket
panel = Panel("BuyTicket")
enterexist_ids = Text(["line00", "line01", "line02", "line03", "line04", "line05", "line06", "line07", "line08", "line09", "line10", "line11", "line12", "line13"])
pt_4 = Point([Point(245.0808883, 34.80018594, 0), Point(246.520353, 34.80018594, 0), Point(247.9598177, 34.80018594, 0), Point(249.3992824, 34.80018594, 0), Point(250.8387471, 34.80018594, 0), Point(252.2782119, 34.80018594, 0), Point(253.7176766, 34.80018594, 0), Point(255.1571413, 34.80018594, 0), Point(256.596606, 34.80018594, 0), Point(258.0360707, 34.80018594, 0), Point(259.4755354, 34.80018594, 0), Point(260.9150002, 34.80018594, 0), Point(262.3544649, 34.80018594, 0), Point(263.7939296, 34.80018594, 0)])
rec = Rectangle({Plane=PlaneXY(254.5200343, 31.16101843, 0), Size=Domain2(u=-10.15883401..10.15883401, v=-4.642430796..4.642430796)})
列队占位生成器 = CSharpScript(ori_pt=pt_4, Iter=Slider(8, range=0..1000))  # -> out, A; inputs ori_pt: list of Point3d, Iter: Int32
# ---------- 列队占位生成器: C# ----------
    DataTree<Point3d> tree_pts = new DataTree<Point3d>();
    for(int i = 0;i < ori_pt.Count;i++)
    {
      tree_pts.AddRange(QueuePt(ori_pt[i], Iter, 0.5), new GH_Path(i));
    }
    A = tree_pts;
# ---------- 列队占位生成器: C# additional code ----------
  private List<Point3d> QueuePt(Point3d o, int iter, double D)
  {
    List<Point3d> list = new List<Point3d>();

    for(int i = 0;i < iter;i++)
    {
      list.Add(new Point3d(o.X, o.Y - i * D, o.Z));
    }
    return list;
  }

  private List<Point3d> RotatePt(Point3d o, int iter, double R)
  {
    List<Point3d> list = new List<Point3d>();
    int lay = 1;
    int sum = 0;
    int count = lay * 6;

    for(int i = 0;i < iter;i++)
    {
      double a = Math.PI / (count * 0.5);
      double r = 2 * R * lay;

      double b = a * (i - sum);
      list.Add(new Point3d(o.X + Math.Sin(b) * r, o.Y + Math.Cos(b) * r, o.Z));

      if(i == sum + count - 1)
      {
        lay++;
        sum += count;
        count = lay * 6;
      }
    }

    return list;
  }
# ---------- end 列队占位生成器 ----------
ievent_m_vs_as_st_q = IEvent_M_vS_aS_St_Q(ID=enterexist_ids, Class=panel, Pt=pt_4, Ps=列队占位生成器.A, Time="100", ADist=Slider(0.2, range=0..1), RT=rec, Po=2)

# ----
# CheckIn
panel_2 = Panel("CheckIn")
enterexist_ids_2 = Text(["CheckIn01", "CheckIn02", "CheckIn03"])
pt_5 = Point([Point(276.841095, 33.90872192, 0), Point(276.5286255, 32.05133438, 0), Point(276.1849976, 30.23104477, 0)])
rec_2 = Rectangle({Plane=PlaneXY(270.9215718, 32.55423144, 0), Size=Domain2(u=-6.407865472..6.407865472, v=-3.249217785..3.249217785)})
列队占位生成器_2 = CSharpScript(ori_pt=pt_5, Iter=Slider(15, range=0..1000))  # -> out, A; inputs ori_pt: list of Point3d, Iter: Int32
# ---------- 列队占位生成器_2: C# ----------
    DataTree<Point3d> tree_pts = new DataTree<Point3d>();
    for(int i = 0;i < ori_pt.Count;i++)
    {
      tree_pts.AddRange(QueuePt(ori_pt[i], Iter, 0.8), new GH_Path(i));
    }
    A = tree_pts;
# ---------- 列队占位生成器_2: C# additional code ----------
  private List<Point3d> QueuePt(Point3d o, int iter, double D)
  {
    List<Point3d> list = new List<Point3d>();

    for(int i = 0;i < iter;i++)
    {
      list.Add(new Point3d(o.X - i * D, o.Y, o.Z));
    }
    return list;
  }

  private List<Point3d> RotatePt(Point3d o, int iter, double R)
  {
    List<Point3d> list = new List<Point3d>();
    int lay = 1;
    int sum = 0;
    int count = lay * 6;

    for(int i = 0;i < iter;i++)
    {
      double a = Math.PI / (count * 0.5);
      double r = 2 * R * lay;

      double b = a * (i - sum);
      list.Add(new Point3d(o.X + Math.Sin(b) * r, o.Y + Math.Cos(b) * r, o.Z));

      if(i == sum + count - 1)
      {
        lay++;
        sum += count;
        count = lay * 6;
      }
    }

    return list;
  }
# ---------- end 列队占位生成器_2 ----------
ievent_m_vs_as_st_q_2 = IEvent_M_vS_aS_St_Q(ID=enterexist_ids_2, Class=panel_2, Pt=pt_5, Ps=列队占位生成器_2.A, Time="10", ADist=Slider(0.4, range=0..1), RT=rec_2, Po=2)

# ----
# Exist
enterexist_locations = Point([Point(230.6141239, 22.6585807, 0), Point(230.6141239, 21.66270059, 0), Point(230.6141239, 20.70915599, 0), Point(230.6141239, 19.78604505, 0)])
lng = ListLength(List=enterexist_locations)
series = Series(Start=0, Step=1, Count=lng)
concat = Concatenate(FragmentA="Exsit_station", FragmentB=series)
ievent_exit = IEvent_Exit(ID=concat, Pt=enterexist_locations, ADist=0.3)

int = Integer(agent_count)
randomgen = CSharpScript(n=int, o=train_stations, s=number_slider)  # -> out, A; inputs n: Int32, o: list, s: Int32
# ---------- randomgen: C# ----------
    Random r = new Random(s);

    List<Object> objs = new List<Object>();
    for(int i = 0;i < n;i++)
    {
      objs.Add(o[r.Next(0, o.Count)]);
    }

    A = objs;
# ---------- end randomgen ----------
randomgen_2 = CSharpScript(n=int, o=concat, s=number_slider)  # -> out, simplify(graft(A)); inputs n: Int32, o: list, s: Int32; same code as randomgen
panel_3 = Panel("""CheckOut
Shopping""")
series_2 = Series(Start=0, Step=1, Count=int)
repeat_by_tree = CSharpScript(
    T=panel_3,
    Count=int,
    Reference=["C:\USERS\SYCAR\ONEDRIVE\NET_LIBRARY\BSim.dll", "C:\Users\sycar\OneDrive\NET_Library\BSim.dll"])  # -> Tree; inputs T: list, Count: Int32
# ---------- repeat_by_tree: C# usings ----------
using BSim;

using System.Windows.Forms;

using System.Linq;

//using KangarooSolver;
# ---------- repeat_by_tree: C# ----------
    DataTree<Object> tree = new DataTree<Object>();

    for(int i = 0;i < Count;i++)
    {
      tree.AddRange(T, new GH_Path(i));
    }
    Tree = tree;
# ---------- end repeat_by_tree ----------
merge_2 = Merge(Data1=repeat_by_tree, Data2=randomgen_2.A)
multiplication = Multiplication(A=series_2, B=Slider(20, range=0..100))
concat_2 = Concatenate(FragmentA="P_Exsit_", FragmentB=series_2)

# ----
# Exist
enterexist_locations_2 = Point([Point(311.8123852, 35.80344772, -10), Point(311.8124157, 17.10513879, -10), Point(304.3716744, 35.80344772, -10), Point(304.3717049, 17.10513879, -10), Point(296.9309395, 35.80344772, -10), Point(296.93097, 17.10513879, -10), Point(289.4902046, 35.80344772, -10), Point(289.4902351, 17.10513879, -10), Point(282.0494938, 35.80344772, -10), Point(282.0495243, 17.10513879, -10), Point(274.6087349, 35.80344772, -10), Point(274.6087654, 17.10513879, -10), Point(267.168, 35.80344771, -10), Point(267.1680306, 17.10513878, -10)])
lng_2 = ListLength(List=enterexist_locations_2)
series_3 = Series(Start=0, Step=1, Count=lng_2)
concat_3 = Concatenate(FragmentA="Exsit_train", FragmentB=series_3)
ievent_exit_2 = IEvent_Exit(ID=concat_3, Pt=enterexist_locations_2, ADist=0.3)

# ----
# Agents
# (From stations to exsit)
int_2 = Integer(agent_count)
randomgen_3 = CSharpScript(n=int_2, o=enter_exits, s=Slider(1000, range=0..1000))  # -> out, A; inputs n: Int32, o: list, s: Int32; same code as randomgen
randomgen_4 = CSharpScript(n=int_2, o=concat_3, s=number_slider)  # -> out, simplify(graft(A)); inputs n: Int32, o: list, s: Int32; same code as randomgen
panel_4 = Panel("""BuyTicket
CheckIn
Seat""")
series_4 = Series(Start=0, Step=1, Count=int_2)
repeat_by_tree_2 = CSharpScript(
    T=panel_4,
    Count=int_2,
    Reference=["C:\USERS\SYCAR\ONEDRIVE\NET_LIBRARY\BSim.dll", "C:\Users\sycar\OneDrive\NET_Library\BSim.dll"])  # -> Tree; inputs T: list, Count: Int32; same code as repeat_by_tree
concat_4 = Concatenate(FragmentA="P_Enter_", FragmentB=series_4)
multiplication_2 = Multiplication(A=series_4, B=Slider(20, range=0..100))
merge_3 = Merge(Data1=repeat_by_tree_2, Data2=randomgen_4.A)

# ----
# CheckOut
number_slider_2 = Slider(15, range=0..1000)
enterexist_ids_3 = Text(["CheckOut01", "CheckOut02", "CheckOut03"])
pt_6 = Point([Point(276.1123962, 22.06368256, 0), Point(276.2614746, 20.12981796, 0), Point(276.3429871, 18.12724304, 0)])
rec_3 = Rectangle({Plane=PlaneXY(281.7044449, 20.06984697, 0), Size=Domain2(u=-6.432996884..6.432996884, v=-2.408136528..2.408136528)})
列队占位生成器_3 = CSharpScript(ori_pt=pt_6, Iter=number_slider_2)  # -> out, A; inputs ori_pt: list of Point3d, Iter: Int32
# ---------- 列队占位生成器_3: C# ----------
    DataTree<Point3d> tree_pts = new DataTree<Point3d>();
    for(int i = 0;i < ori_pt.Count;i++)
    {
      tree_pts.AddRange(QueuePt(ori_pt[i], Iter, 0.8), new GH_Path(i));
    }
    A = tree_pts;
# ---------- 列队占位生成器_3: C# additional code ----------
  private List<Point3d> QueuePt(Point3d o, int iter, double D)
  {
    List<Point3d> list = new List<Point3d>();

    for(int i = 0;i < iter;i++)
    {
      list.Add(new Point3d(o.X + i * D, o.Y, o.Z));
    }
    return list;
  }

  private List<Point3d> RotatePt(Point3d o, int iter, double R)
  {
    List<Point3d> list = new List<Point3d>();
    int lay = 1;
    int sum = 0;
    int count = lay * 6;

    for(int i = 0;i < iter;i++)
    {
      double a = Math.PI / (count * 0.5);
      double r = 2 * R * lay;

      double b = a * (i - sum);
      list.Add(new Point3d(o.X + Math.Sin(b) * r, o.Y + Math.Cos(b) * r, o.Z));

      if(i == sum + count - 1)
      {
        lay++;
        sum += count;
        count = lay * 6;
      }
    }

    return list;
  }
# ---------- end 列队占位生成器_3 ----------
ievent_m_vs_as_st_q_3 = IEvent_M_vS_aS_St_Q(ID=enterexist_ids_3, Class="CheckOut", Pt=pt_6, Ps=列队占位生成器_3.A, Time="30", ADist=Slider(0.4, range=0..1), RT=rec_3, Po=2)

# ----
# Shopping
pt_7 = Point(Point(244.9154968, 13.81077576, 0))
enterexist_ids_4 = Text("Shopping01")
pt_8 = Point([Point(244.9154968, 13.81077576, 0), Point(244.9154663, 12.71264839, 0), Point(246.0456238, 13.81077194, 0), Point(247.1758118, 13.81076241, 0), Point(248.3059387, 13.81075287, 0), Point(249.4360504, 13.81075382, 0), Point(250.5661316, 13.81074524, 0), Point(251.6962891, 13.81072617, 0), Point(252.8264771, 13.81070709, 0), Point(252.8264618, 12.71259499, 0), Point(251.6963196, 12.71260071, 0), Point(250.5661621, 12.71259117, 0), Point(249.4360352, 12.71257877, 0), Point(248.3059082, 12.71258354, 0), Point(247.175766, 12.71261597, 0), Point(246.0455933, 12.71264267, 0), Point(255.086853, 14.90880394, 0), Point(255.086853, 13.8106842, 0), Point(255.0868225, 12.71256828, 0), Point(255.0868225, 11.61444664, 0)])
box = Box({Plane=PlaneXY(242.6551514, 10.5163269, -0.4744629049), X=Domain(0, 13.56182861), Y=Domain(0, 5.490684509), Z=Domain(0, 1.117868027)})
number_slider_3 = Slider(25, range=0..1000)
ievent_m_vs_as_st = IEvent_M_vS_aS_St(ID=enterexist_ids_4, Class="Shopping", Pt=pt_7, Ps=pt_8, Time="10", ADist=Slider(0.6, range=0..1), RT=box, Po=0)

# ----
# Take Seat
pt_9 = Point([Point(286.3013073, 32.68706131, -10), Point(287.3642651, 32.68706131, -10), Point(288.4272229, 32.68706131, -10), Point(286.3013073, 31.64826393, -10), Point(287.3642651, 31.64826393, -10), Point(288.4272229, 31.64826393, -10)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])
lng_3 = ListLength(List=pt_9)
series_5 = Series(Start=0, Step=1, Count=lng_3)
concat_5 = Concatenate(FragmentA="seat", FragmentB=series_5)
ievent_s_vs_as_st = IEvent_S_vS_aS_St(ID=concat_5, Class="Seat", Pt=pt_9, Time="300", ADist=Slider(0.2, range=0..1), Ra="5", Po=1)

displaycurves_2 = DisPlayCurves(cvs=flatten(crv_2), cols=flatten(ColourSwatch(SwatchColor=RGB(33, 33, 33))), thick=flatten(Slider(2, range=0..10)))
# Initialize the ISpace
# by clicking the button
preprspace = PreprSpace(Net=subwaycase, Div=1)
panel_5 = Panel("""\poss\g_walk.3dm
\poss\g_seat.3dm
\poss\g_talk.3dm""")
agent_bhav = Agent_Bhav(ToDoList=merge_3)  # -> flatten(Bhav)
agent_bhav_2 = Agent_Bhav(ToDoList=merge_2)  # -> flatten(Bhav)

agent_meta = Agent_Meta(BirthIter=multiplication)
agent_view = Agent_View(VDist=20, VAngl=1.2)
agent_attr = Agent_Attr(ID=concat_2, Pt=randomgen.A, StR=2, R=0.3, Tol=1, Spd=0.01, Col=ColourSwatch(SwatchColor=RGB(255, 3, 3)), GeoP=panel_5)

agent_meta_2 = Agent_Meta(BirthIter=multiplication_2)
agent_view_2 = Agent_View(VDist=20, VAngl=1.2)
agent_attr_2 = Agent_Attr(
    ID=concat_4,
    Pt=randomgen_3.A,
    StR=2,
    R=0.3,
    Tol=1,
    Spd=0.01,
    Col=ColourSwatch(SwatchColor=RGB(0, 255, 174)),
    GeoP=panel_5)

merge_4 = Merge(
    Data1=ievent_exit_2,
    Data2=ievent_exit,
    Data3=ievent_m_vs_as_st_q,
    Data4=ievent_m_vs_as_st_q_2,
    Data5=ievent_m_vs_as_st_q_3,
    Data6=ievent_m_vs_as_st,
    Data7=ievent_s_vs_as_st)  # -> flatten(Result)
interact_avoid = Interact_Avoid(AffectCoeff=1.1, StR=2)
agent = Agent(Attr=agent_attr, Bhav=agent_bhav_2, Meta=agent_meta, View=agent_view)
agent_2 = Agent(Attr=agent_attr_2, Bhav=agent_bhav, Meta=agent_meta_2, View=agent_view_2)
# Click Reset and Run to trigger the simulation
number_slider_4 = Slider(404, range=0..10000)
abm = ABM(S=preprspace, A=flatten([agent, agent_2]), E=flatten(merge_4), I=interact_avoid)
simulator = Simulator(ABM=abm)  # -> ABM, Log
panel_6 = Panel(simulator.Log)
displ_agents = Displ_Agents(ABM=simulator.ABM)

crv_3 = Curve(check_nodeedge_clouds.Matched_Es)
crv_4 = Curve([<curve referenced from the Rhino model> x2120])
crv_5 = Curve(crv_4)
pathnettest = CSharpScript(
    Run=Button(),
    PathNet=crv_4,
    Reference=["C:\Program Files\Rhino 7\Plug-ins\Grasshopper\Components\KangarooSolver.dll", "C:\USERS\SYCAR\ONEDRIVE\NET_LIBRARY\BSim.dll"])  # -> out, Ns, St_N, Rc_N, Er_N; inputs Run: Boolean, PathNet: list of Line
# ---------- pathnettest: C# usings ----------
using System.Linq;
using BSim;
using System.Diagnostics;
using System.IO;
using Path=BSim.PathNet;
using System.Windows.Forms;
# ---------- pathnettest: C# ----------
    if(Run)
    {
      Path.ShortPathGraph Graph = Path.PathNetWork(PathNet, tol, out Nodes);
      report = "";
      Record_path = new List<List<List<int>>>();

      //Load the Environment;
      W = new MiniWatch();

      List<int> reach_indices = new List<int>();
      List<int> error_indices = new List<int>();

      for(int i = 0;i < 1;i++)//Nodes.Count[Change this para to see the consistensy of the entire system]
      {
        bool ifFail = false;
        List<List<int>> Node_i_matrix = Graph.Dijkstra_Record(i);

        reach_indices = new List<int>();
        error_indices = new List<int>();
        for(int j = 0;j < Nodes.Count;j++)
        {
          if(i != j && Node_i_matrix[j].Count < 2)
          {
            error_indices.Add(j);
            ifFail = true;
          }
          else
          {
            reach_indices.Add(j);
          }

        }

        if(ifFail)
        {
          rcPoints = reach_indices.Select(p => Nodes[p]).ToList();
          erPoints = error_indices.Select(p => Nodes[p]).ToList();
          stPoint = Nodes[i];
          report += "\nFail\n";
          break;
        }

        stPoint = Point3d.Origin;
        rcPoints = Nodes;
        if(erPoints != null)erPoints.Clear();
        Record_path.Add(Graph.Dijkstra_Record(i));
        W.Record("SubIter_" + i.ToString());
      }

      W.Record("Dijkstra");

      report = W.GetTime();
    }
    Component.Message = report;
    Ns = Nodes;
    St_N = stPoint;
    Rc_N = rcPoints;
    Er_N = erPoints;
# ---------- pathnettest: C# additional code ----------
  double tol = 0.0001;
  MiniWatch W;
  List<List<List<int>>> Record_path;
  List<Point3d> Nodes;
  Point3d stPoint;
  List<Point3d>rcPoints;
  List<Point3d>erPoints;

  string report = "";

  private void ExportToCSV(string path, List<List<List<int>>> data)
  {
    using (StreamWriter writer = new StreamWriter(path))
    {
      foreach (List<List<int>> sublist in data)
      {
        var row = string.Join(";", sublist.Select(innerList => string.Join(",", innerList)));
        writer.WriteLine(row);
      }
    }
  }

  private List<List<List<int>>> ImportFromCSV(string path)
  {
    List<List<List<int>>> data = new List<List<List<int>>>();

    using (StreamReader reader = new StreamReader(path))
    {
      while (!reader.EndOfStream)
      {
        string line = reader.ReadLine();
        var sublist = line.Split(';')
          .Select(segment => segment.Split(',')
          .Select(int.Parse)
          .ToList())
          .ToList();

        data.Add(sublist);
      }
    }

    return data;
  }
# ---------- end pathnettest ----------
looking_for_3degree_nodes = CSharpScript(NodeCloud=pathnettest.Ns, EdgeCloud=crv_5, tol=Slider(0.0001, range=0..1))  # -> out, Matched_Es, Matched_Ns, Error_E, Error_N; inputs NodeCloud: list of Point3d, EdgeCloud: list of Line, tol: Double
# ---------- looking_for_3degree_nodes: C# ----------
    List<Point3d> nodes = NodeCloud;

    //01 match edge;
    double fixtol = tol;
    RTree rtree = new RTree();
    for(int i = 0;i < nodes.Count;i++){rtree.Insert(nodes[i], i);}
    List<List<int>> nodenodeAdj = nodes.Select(p => new List<int>()).ToList();


    for(int i = 0;i < EdgeCloud.Count;i++)
    {
      int n = nodes.Count-1;
      Point3d P0 = EdgeCloud[i].From;
      Point3d P1 = EdgeCloud[i].To;
      
      rtree.Insert(P0, i*2+n);
      rtree.Insert(P1, i*2+n+1);
    }
    
    List <Point3d> nodes3d = new List<Point3d>();
    foreach(Point3d p in nodes)
    {
      Sphere SearchSp0 = new Sphere(p, fixtol);
      List<int> match0 = new List<int>();
      rtree.Search(SearchSp0, (sender, args) => { match0.Add(args.Id); });
      
      if(match0.Count > 3)
      {
        nodes3d.Add(p);
      }
    }

    Matched_Ns = nodes3d;
# ---------- looking_for_3degree_nodes: C# additional code ----------
  public static int? RT_ClosetPt(List<Point3d> ptCloud, RTree T, Point3d pt, double R)
  {
    Sphere SearchSp = new Sphere(pt, R);
    if (T != null)
    {
      List<int> candidates = new List<int>();
      T.Search(SearchSp, (sender, args) => { candidates.Add(args.Id); });
      if (candidates.Count > 0)
      {
        candidates.Sort((a, b) => ptCloud[a].DistanceTo(pt).CompareTo(ptCloud[b].DistanceTo(pt)));
        return candidates[0];
      }
      else { return null; }
    }
    else { return null; }
  }
# ---------- end looking_for_3degree_nodes ----------
pt_10 = Point(pathnettest.Er_N)
dots = DotDisplay(Point=pathnettest.Rc_N, Colour=ColourSwatch(SwatchColor=RGB(84, 142, 61)), Size=1)
dots_2 = DotDisplay(Point=pathnettest.Er_N, Colour=ColourSwatch(SwatchColor=RGB(230, 22, 61)), Size=0.8)
dots_3 = DotDisplay(Point=pathnettest.St_N, Colour=RGB(0, 0, 0), Size=1.4)
pt_11 = Point(looking_for_3degree_nodes.Matched_Ns)

save_load = SaveLoad()
extractresult = ExtractResult(Doc=save_load, AtIter=number_slider_4)  # -> ID, Pt, Col, St
dots_4 = DotDisplay(Point=extractresult.Pt, Colour=extractresult.Col, Size=0.1)

crv_6 = Curve([<curve referenced from the Rhino model> x1958])
explode = Explode(Curve=crv_6, Recursive=True)  # -> Segments, Vertices
polyline_optimize = CSharpScript(Pts=explode.Vertices, t=Slider(0.9, range=0..2))  # -> out, Angs, SPts; inputs Pts: list of Point3d, t: Double
# ---------- polyline_optimize: C# ----------
    if(Pts.Count == 0){return;}
    if(t <= 0.0){t = 0.8;}
    List<Vector3d> vecs = new List<Vector3d>(Pts.Count - 1);

    for(int i = 0;i < Pts.Count - 1;i++)
    {
      vecs.Add(new Vector3d(Pts[i + 1] - Pts[i]));
    }

    List<double> angles = new List<double>(vecs.Count - 1);
    for(int i = 0;i < vecs.Count - 1;i++)
    {
      Vector3d vec0 = vecs[i];vec0.Unitize();
      Vector3d vec1 = vecs[i + 1];vec1.Unitize();
      double angle = vec0 * vec1;
      angles.Add(angle);
    }

    List < Point3d > keyPts = new List<Point3d>(){Pts[0]};
    for(int i = 0;i < angles.Count;i++)
    {
      if(angles[i] < t){keyPts.Add(Pts[i + 1]);}
    }
    keyPts.Add(Pts[Pts.Count - 1]);
    Angs = angles;
    SPts = keyPts;
# ---------- end polyline_optimize ----------
pline = PolyLine(Vertices=polyline_optimize.SPts, Closed=False)
panel_7 = Panel(polyline_optimize.Angs)
explode_2 = Explode(Curve=pline, Recursive=True)  # -> flatten(Segments), Vertices
line = Line(explode_2.Segments)

# ==== cluster DisPlayCurves
cvs = ClusterInput()
thick = ClusterInput()
cols = ClusterInput()
c_script = CSharpScript(cvs=cvs, cols=cols, thick=thick)  # inputs cvs: list of Curve, cols: list of Color, thick: list of Double
# ---------- c_script: C# usings ----------
using System.IO;
using System.Linq;
using System.Data;
using System.Drawing;
using System.Reflection;
using System.Windows.Forms;
using System.Xml;

using System.Runtime.InteropServices;

using Rhino.DocObjects;
using Rhino.Collections;
using GH_IO;
using GH_IO.Serialization;
# ---------- c_script: C# ----------
    dis_cvs.Clear();
    dis_cols.Clear();
    dis_th.Clear();
    List<int> valid = Enumerable.Range(0, cvs.Count).Where(i => cvs[i].IsValid).ToList();

    if(cvs == null){return;}
    dis_cvs = valid.Select(i => cvs[i]).ToList();
    if(cols.Count == 1){      dis_cols = valid.Select(p => cols[0]).ToList();}
    else if(cols.Count == 0){      dis_cols = valid.Select(p => Color.Black).ToList();}
    else{dis_cols = valid.Select(i => cols[i]).ToList();}

    if(thick.Count == 1) {dis_th = valid.Select(p => thick[0]).ToList();}
    else if(thick.Count == 0){dis_th = valid.Select(p => 1.0).ToList();}
    else{dis_th = valid.Select(i => thick[i]).ToList();}
# ---------- c_script: C# additional code ----------
  private List<Curve> dis_cvs = new List<Curve>();
  private List<Color> dis_cols = new List<Color>();
  private List<double> dis_th = new List<double>();

  public override void BeforeRunScript()
  {
    dis_cvs.Clear();
    dis_cols.Clear();
    dis_th.Clear();
  }

  public override BoundingBox ClippingBox
  {
    get
    {
      return BoundingBox.Empty;
    }
  }

  public override void DrawViewportWires(IGH_PreviewArgs args)
  {
    Plane pl0_Plane;
    args.Viewport.GetFrustumFarPlane(out pl0_Plane);

    Rhino.Display.Text3d drawText = null;  // Initialize to null

    for (int i = 0; i < dis_cvs.Count; i++)
    {
      Curve cv = dis_cvs[i];
      Color col = dis_cols[i];
      double th = dis_th[i];

      pl0_Plane.Origin = cv.PointAt(0.5 * cv.Domain.Length);

      args.Display.DrawCurve(cv, col, System.Convert.ToInt32(th));

      // Create a new Text3d object
      //drawText = new Rhino.Display.Text3d(txt, pl0_Plane, txt_size);
      //args.Display.Draw3dText(drawText, col);
    }

    // Dispose of the last Text3d object
    if (drawText != null)
    {
      drawText.Dispose();
    }
  }
# ---------- end c_script ----------
